# Grasshopper definition modularizerFinal.gh (Grasshopper 1.0.7)
# plug-ins: Capture, Sift, Sampler, karambaGH, goat

# ---- group: rotationVar
additionalrotation = Slider(45, range=0..89)

# ---- group: profileCrvVar
middle = Slider(4.75, range=-15..15)
left = Slider(4.75, range=-15..15)
right = Slider(-11.25, range=-15..15)

# ----
Z = UnitZ(Factor=Slider(9.5, range=0..10))
license = LicenseKaramba3D()
brep = Brep(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)
neg = Negative(Value=Z)
Y = UnitY(Factor=Slider(20, range=0..100))
move = Move(Geometry=brep, Motion=neg)  # -> Geometry, Transform
neg_2 = Negative(Value=Y)
X = UnitX(Factor=Slider(16, range=0..20))
move_2 = Move(Geometry=move.Geometry, Motion=neg_2)  # -> Geometry, Transform
neg_3 = Negative(Value=X)
move_3 = Move(Geometry=move_2.Geometry, Motion=neg_3)  # -> Geometry, Transform

# ---- group: H7
panel = Panel("""29.75
-12.5
-0.5
-6.5""")
partition = PartitionList(List=panel, Size="4")
h5 = Panel(partition)
split = SplitList(List=h5, Index=1)  # -> ListA, ListB
panel_2 = Panel(split.ListB)
panel_3 = Panel(split.ListA)
performance = Panel("""1.001678
2.571892
2.129011
2.424096
2.576452
2.937675
2.202173
2.834999
1.86516
1.64413
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""")

panel_4 = Panel("""31.625
-1.75
10.75
2.25
28.125
1.75
5.75
8.75
30.125
-4.75
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""")
partition_2 = PartitionList(List=panel_4, Size="4")
h5_2 = Panel(partition_2)
split_2 = SplitList(List=h5_2, Index=1)  # -> ListA, ListB
panel_5 = Panel(split_2.ListB)
panel_6 = Panel(split_2.ListA)
performance_2 = Panel("""2.208574
2.237656
1.912701
3.177868
1.861657
2.313161
2.639776
2.355964
2.856033
2.571892
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""")

# ---- group: H3
panel_7 = Panel("""9.75
-14.5
12.5
-9.5
6.75
-4.5
-12.5
14.5
42.75
3.5
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""")
partition_3 = PartitionList(List=panel_7, Size="4")
panel_8 = Panel(partition_3)
split_3 = SplitList(List=panel_8, Index=1)  # -> ListA, ListB
panel_9 = Panel(split_3.ListA)
panel_10 = Panel(split_3.ListB)
panel_11 = Panel("""2.6363
1.293115
2.58369
1.68616
2.089524
3.304545
1.680265
3.199858
1.326702
0.791397
3.013325
2.279477
1.958022
1.663998
1.98976
3.122646
1.475085
1.560553
0.951183
2.985871
1.173893
1.112867
2.09179
1.717014
0.386779
1.059523
2.072218
2.620276
2.878232
1.017017""")

# ---- group: H5
panel_12 = Panel("""39.25
-0.5
-10.5
-4.5
28.25
-13.5
-7.5
-10.5
37.75
-10.5
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""")
partition_4 = PartitionList(List=panel_12, Size="4")
h5_3 = Panel(partition_4)
split_4 = SplitList(List=h5_3, Index=1)  # -> ListA, ListB
panel_13 = Panel(split_4.ListB)
panel_14 = Panel(split_4.ListA)
performance_3 = Panel("""1.987361
0.680815
1.644693
1.964709
1.696385
1.717526
2.956287
2.306435
2.106877
1.697668
2.183645
3.397364
2.04117
2.026979
2.459981
2.982706
2.354735
2.159926
2.2879
2.291209
1.299918
2.121209
1.740326
1.449754
2.01054
2.817658
2.141683
2.231079
1.772544
1.655486""")

# ---- group: H6
panel_15 = Panel("""31.75
-10.5
-12.5
-2.5
29.25
-1.5
-13.5
4.5
29.75
-4.5
-8.5
0.5
25.75
-14.5
0.5
-9.5""")
partition_5 = PartitionList(List=panel_15, Size="4")
h5_4 = Panel(partition_5)
split_5 = SplitList(List=h5_4, Index=1)  # -> ListA, ListB
panel_16 = Panel("""1.034093
1.081141
1.180686
1.095581""")
panel_17 = Panel(split_5.ListA)
panel_18 = Panel(split_5.ListB)

# ---- group: Hyper2
panel_19 = Panel("""78.616667
-1.5
4.5
14.5
81.583333
9.5
-0.5
-8.5
10.383333
10.5
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""")
partition_6 = PartitionList(List=panel_19, Size="4")
panel_20 = Panel(partition_6)
split_6 = SplitList(List=panel_20, Index=1)  # -> ListA, ListB
panel_21 = Panel(split_6.ListB)
panel_22 = Panel("""7.320274
2.128847
2.115156
2.012619
3.329601
2.005108
2.041383
1.555549
3.022886
1.488203
2.71884
3.258193
1.200569
1.585308
1.703118
2.348633
2.292215
2.404099
0.714078
2.516219
1.478522
0.3358
1.977219
3.70259
3.744473
1.904108
1.542815
1.558559
1.64015
3.464621""")
panel_23 = Panel(split_6.ListA)

# ----
debrep = DeconstructBrep(Brep=move_3.Geometry)  # -> Faces, Edges, Vertices
geo = Geometry(move_3.Geometry)
item = ListItem(List=debrep.Faces, Index=0, Wrap=True)  # -> Item, Item1, Item2, Item3, Item4, Item5
select_index = Panel("""0
1
2
3""")
select_index_2 = Panel("""25
40""")
select_index_3 = Panel("0")
number_slider = Slider(3, range=0..20)
Z_2 = UnitZ(Factor=1)

# ---- group: RandomSamples
panel_24 = Panel("""87.486661
-1.65245
12.545619
-9.31429
53.836038
4.739963
-11.823595
-6.198572
40.007566
7.346489
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""")
partition_7 = PartitionList(List=panel_24, Size="4")
panel_25 = Panel(partition_7)
split_7 = SplitList(List=panel_25, Index=1)  # -> ListA, ListB
panel_26 = Panel(split_7.ListB)
panel_27 = Panel(split_7.ListA)
panel_28 = Panel("""1.046815
2.295755
2.139606
1.267357
2.040785
2.420928
3.023684
2.429728
0.719724
2.855316
1.591315
2.012937
1.838065
2.310155
1.704625
1.285162
3.376148
1.297062
1.354761
3.158392
2.087004
2.800784
1.677582
1.546212
1.763136
2.089979
2.352404
1.315504
2.218742
2.374476""")

# ----
Y_2 = UnitY(Factor=1)
select_index_4 = Panel("1")
select_index_5 = Panel("""24
9
18
29
25
21
20
1 """)
nummodule = Slider(25, range=5..30)
panel_29 = Panel("0,7,9,12,18,20,21,26")

# ---- group: top_conn
Y_3 = UnitY(Factor=Slider(5, range=0..10))
Y_4 = UnitY(Factor=Slider(2.5, range=0..10))
Y_5 = UnitY(Factor=Slider(7.5, range=0..10))
neg_4 = Negative(Value=Y_5)
neg_5 = Negative(Value=Y_3)
neg_6 = Negative(Value=Y_4)
area = Area(Geometry=item.Item5)  # -> Area, Centroid
move_4 = Move(Geometry=area.Centroid, Motion=neg_4)  # -> Geometry, Transform
move_5 = Move(Geometry=area.Centroid, Motion=neg_5)  # -> Geometry, Transform
move_6 = Move(Geometry=area.Centroid, Motion=neg_6)  # -> Geometry, Transform
move_7 = Move(Geometry=area.Centroid, Motion=Y_4)  # -> Geometry, Transform
move_8 = Move(Geometry=area.Centroid, Motion=Y_3)  # -> Geometry, Transform
move_9 = Move(Geometry=area.Centroid, Motion=Y_5)  # -> Geometry, Transform
line = LineSDL(Start=move_9.Geometry, Direction=Y_2, Length=number_slider)
line_2 = LineSDL(Start=area.Centroid, Direction=Y_2, Length=number_slider)
line_3 = LineSDL(Start=move_7.Geometry, Direction=Y_2, Length=number_slider)
line_4 = LineSDL(Start=move_8.Geometry, Direction=Y_2, Length=number_slider)
line_5 = LineSDL(Start=move_6.Geometry, Direction=Y_2, Length=number_slider)
line_6 = LineSDL(Start=move_4.Geometry, Direction=Y_2, Length=number_slider)
line_7 = LineSDL(Start=move_5.Geometry, Direction=Y_2, Length=number_slider)
merge = Merge(Data1=line_6, Data2=line_7, Data3=line_5, Data4=line_2, Data5=line_3, Data6=line_4, Data7=line)
merge_2 = Merge(
    Data1=move_4.Geometry,
    Data2=move_5.Geometry,
    Data3=move_6.Geometry,
    Data4=area.Centroid,
    Data5=move_7.Geometry,
    Data6=move_8.Geometry,
    Data7=move_9.Geometry)
pt = Point([move_5.Geometry, area.Centroid, move_8.Geometry])
crv = Curve([line_7, line_2, line_4])
conndir = Wasp_ConnectionFromDirection(GEO=geo, CEN=pt, UP=crv, T="s_top")  # -> CONN, PLN_OUT; inputs CEN: list of Point3d, UP: list of Curve, T: list; plug-in component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

# ---- group: ends_conn
area_2 = Area(Geometry=item.Item3)  # -> Area, Centroid
area_3 = Area(Geometry=item.Item4)  # -> Area, Centroid
line_8 = LineSDL(Start=area_3.Centroid, Direction=Z_2, Length=number_slider)
line_9 = LineSDL(Start=area_2.Centroid, Direction=Z_2, Length=number_slider)
crv_2 = Curve([line_9, line_8])
pt_2 = Point([area_2.Centroid, area_3.Centroid])
conndir_2 = Wasp_ConnectionFromDirection(GEO=geo, CEN=pt_2, UP=crv_2, T="s_ends")  # -> CONN, PLN_OUT; inputs CEN: list of Point3d, UP: list of Curve, T: list; plug-in component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

# ----
crv_3 = Curve(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)

# ---- group: sideL_conn
Y_6 = UnitY(Factor=Slider(5, range=0..10))
Y_7 = UnitY(Factor=Slider(7.5, range=0..10))
Y_8 = UnitY(Factor=Slider(2.5, range=0..10))
neg_7 = Negative(Value=Y_7)
neg_8 = Negative(Value=Y_8)
neg_9 = Negative(Value=Y_6)
area_4 = Area(Geometry=item.Item)  # -> Area, Centroid
move_10 = Move(Geometry=area_4.Centroid, Motion=neg_8)  # -> Geometry, Transform
move_11 = Move(Geometry=area_4.Centroid, Motion=Y_6)  # -> Geometry, Transform
move_12 = Move(Geometry=area_4.Centroid, Motion=Y_8)  # -> Geometry, Transform
move_13 = Move(Geometry=area_4.Centroid, Motion=Y_7)  # -> Geometry, Transform
move_14 = Move(Geometry=area_4.Centroid, Motion=neg_9)  # -> Geometry, Transform
move_15 = Move(Geometry=area_4.Centroid, Motion=neg_7)  # -> Geometry, Transform
line_10 = LineSDL(Start=area_4.Centroid, Direction=Z_2, Length=number_slider)
line_11 = LineSDL(Start=move_11.Geometry, Direction=Z_2, Length=number_slider)
line_12 = LineSDL(Start=move_14.Geometry, Direction=Z_2, Length=number_slider)
line_13 = LineSDL(Start=move_13.Geometry, Direction=Z_2, Length=number_slider)
line_14 = LineSDL(Start=move_10.Geometry, Direction=Z_2, Length=number_slider)
line_15 = LineSDL(Start=move_12.Geometry, Direction=Z_2, Length=number_slider)
line_16 = LineSDL(Start=move_15.Geometry, Direction=Z_2, Length=number_slider)
merge_3 = Merge(Data1=line_16, Data2=line_12, Data3=line_14, Data4=line_10, Data5=line_15, Data6=line_11, Data7=line_13)
merge_4 = Merge(
    Data1=move_15.Geometry,
    Data2=move_14.Geometry,
    Data3=move_10.Geometry,
    Data4=area_4.Centroid,
    Data5=move_12.Geometry,
    Data6=move_11.Geometry,
    Data7=move_13.Geometry)
crv_4 = Curve([line_12, line_10, line_11])
pt_3 = Point([move_14.Geometry, area_4.Centroid, move_11.Geometry])
conndir_3 = Wasp_ConnectionFromDirection(GEO=geo, CEN=pt_3, UP=crv_4, T="s_sideL")  # -> CONN, PLN_OUT; inputs CEN: list of Point3d, UP: list of Curve, T: list; plug-in component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

# ---- group: sideR_conn
Y_9 = UnitY(Factor=Slider(5, range=0..10))
Y_10 = UnitY(Factor=Slider(7.5, range=0..10))
Y_11 = UnitY(Factor=Slider(2.5, range=0..10))
neg_10 = Negative(Value=Y_9)
neg_11 = Negative(Value=Y_10)
neg_12 = Negative(Value=Y_11)
area_5 = Area(Geometry=item.Item1)  # -> Area, Centroid
move_16 = Move(Geometry=area_5.Centroid, Motion=neg_12)  # -> Geometry, Transform
move_17 = Move(Geometry=area_5.Centroid, Motion=Y_11)  # -> Geometry, Transform
move_18 = Move(Geometry=area_5.Centroid, Motion=Y_9)  # -> Geometry, Transform
move_19 = Move(Geometry=area_5.Centroid, Motion=neg_10)  # -> Geometry, Transform
move_20 = Move(Geometry=area_5.Centroid, Motion=Y_10)  # -> Geometry, Transform
move_21 = Move(Geometry=area_5.Centroid, Motion=neg_11)  # -> Geometry, Transform
line_17 = LineSDL(Start=area_5.Centroid, Direction=Z_2, Length=number_slider)
line_18 = LineSDL(Start=move_19.Geometry, Direction=Z_2, Length=number_slider)
line_19 = LineSDL(Start=move_17.Geometry, Direction=Z_2, Length=number_slider)
line_20 = LineSDL(Start=move_20.Geometry, Direction=Z_2, Length=number_slider)
line_21 = LineSDL(Start=move_18.Geometry, Direction=Z_2, Length=number_slider)
line_22 = LineSDL(Start=move_21.Geometry, Direction=Z_2, Length=number_slider)
line_23 = LineSDL(Start=move_16.Geometry, Direction=Z_2, Length=number_slider)
merge_5 = Merge(
    Data1=move_21.Geometry,
    Data2=move_19.Geometry,
    Data3=move_16.Geometry,
    Data4=area_5.Centroid,
    Data5=move_17.Geometry,
    Data6=move_18.Geometry,
    Data7=move_20.Geometry)
merge_6 = Merge(Data1=line_22, Data2=line_18, Data3=line_23, Data4=line_17, Data5=line_19, Data6=line_21, Data7=line_20)
pt_4 = Point([move_19.Geometry, area_5.Centroid, move_18.Geometry])
crv_5 = Curve([line_18, line_17, line_21])
conndir_4 = Wasp_ConnectionFromDirection(GEO=geo, CEN=pt_4, UP=crv_5, T="s_sideR")  # -> CONN, PLN_OUT; inputs CEN: list of Point3d, UP: list of Curve, T: list; plug-in component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

# ----
cp = ControlPoints(Curve=crv_3)  # -> Points, Weights, Knots
panel_30 = Panel("C:\Users\John Rao\Dropbox (MIT)\MIT_Work\4.451\Project\Presentation\Final\Sampling")
item_2 = ListItem(List=cp.Points, Index=0, Wrap=True)  # -> Item, Item1, Item2, Item3, Item4
Z_3 = UnitZ(Factor=left)
pt_5 = Point(item_2.Item3)
pt_6 = Point(item_2.Item4)
Z_4 = UnitZ(Factor=middle)
pt_7 = Point(item_2.Item2)
Z_5 = UnitZ(Factor=right)
pt_8 = Point(item_2.Item)
pt_9 = Point(item_2.Item1)
sampler = Sampler(
    Variables=[additionalrotation, right, left, middle],
    Samples="60",
    Type="2",
    Seed="0",
    Filename="SamplegHyper_25_40Rot4",
    Directory=panel_30)  # -> DesignMap, Data
panel_31 = Panel(sampler.DesignMap)
panel_32 = Panel(sampler.DesignMap)
sift = Sift(Index=Slider(1, range=0..30))
pdeform = PointDeform(Geometry=crv_3, Points=[pt_9, pt_7, pt_5], Motion=[Z_5, Z_4, Z_3])
panel_33 = Panel("""78.616667
-1.5
4.5
14.5
1.046815
81.583333
9.5
-0.5
-8.5
2.295755
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""")

# ---- group: curveDriven
bbox = BoundingBox(Content=pdeform, Plane=PlaneXY(0, 0, 0))  # -> Box, Box_2
volume = Volume(Geometry=bbox.Box)  # -> Volume, Centroid
scale_nu = ScaleNU(
    Geometry=bbox.Box,
    Plane=volume.Centroid,
    ScaleX=Slider(1.5, range=0..10),
    ScaleY=Slider(1.5, range=0..10),
    ScaleZ=Slider(2, range=0..10))  # -> Geometry, Transform
fieldpts = Wasp_FieldPoints(BOU=scale_nu.Geometry, RES=Slider(4, range=0..10))  # -> E_FIELD, PTS; inputs BOU: list of Mesh; plug-in component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
pull = PullPoint(Point=fieldpts.PTS, Geometry=pdeform, ClosestOnly=True)  # -> ClosestPoint, Distance
bnd = Bounds(Numbers=pull.Distance)
remap = RemapNumbers(Value=pull.Distance, Source=bnd, Target="1 To 0")  # -> Mapped, Clipped
graph = GraphMapper(
    remap.Mapped,
    x0=0,
    x1=1,
    y0=0,
    y1=1,
    container_name="Bezier",
    cpx=[0, 0.6667551398, 0.7424740791, 1],
    cpy=[0, 0.2638700008, 0.4461758137, 1])
field = Wasp_Field(NAME="myField", E_FIELD=fieldpts.E_FIELD, VAL=graph)  # -> FIELD; inputs VAL: list; plug-in component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

# ----
panel_34 = Panel("C:\Users\John Rao\Dropbox (MIT)\MIT_Work\4.451\Project\Presentation\Final\Sampling\Screenshots\Hyper\7")
Y_12 = UnitY(Factor=panel_3)
panel_35 = Panel("C:\Users\John Rao\Dropbox (MIT)\MIT_Work\4.451\Project\Presentation\Final\Sampling")
partition_8 = PartitionList(List=panel_33, Size="5")
panel_36 = Panel(partition_8)
pt_10 = Point(Point(28.28427125, 50, 0))
pt_11 = Point(Point(14.14213562, 25, 0))
pt_12 = Point(Point(42.42640687, 25, 0))
pt_13 = Point(Point(56.56854249, 0, 0))
pt_14 = Point(Point(0, 0, 0))
panel_37 = Panel(split.ListB)
crv_6 = Curve(<curve referenced from the Rhino model>)
pdecon = Deconstruct(Point=pt_11)  # -> XComponent, YComponent, ZComponent
split_8 = SplitList(List=panel_36, Index=4)  # -> ListA, ListB
pdecon_2 = Deconstruct(Point=pt_10)  # -> XComponent, YComponent, ZComponent
pdecon_3 = Deconstruct(Point=pt_12)  # -> XComponent, YComponent, ZComponent
Y_13 = UnitY(Factor=Slider(90, range=0..100))
panel_38 = Panel(pdecon_2.YComponent)
panel_39 = Panel(pdecon.YComponent)
panel_40 = Panel(pdecon_3.YComponent)
panel_41 = Panel(split_8.ListB)
move_22 = Move(Geometry=crv_6, Motion=Y_13)  # -> Geometry, Transform
item_3 = ListItem(List=panel_37, Index=1, Wrap=True)
item_4 = ListItem(List=panel_37, Index=2, Wrap=True)
item_5 = ListItem(List=panel_37, Index=0, Wrap=True)
addition = Addition(A=panel_39, B=item_3)
addition_2 = Addition(A=panel_38, B=item_4)
addition_3 = Addition(A=panel_40, B=item_5)
panel_42 = Panel(addition)
panel_43 = Panel(addition_2)
panel_44 = Panel(addition_3)
pt_15 = ConstructPoint(XCoordinate=pdecon.XComponent, YCoordinate=addition, ZCoordinate=pdecon.ZComponent)
pt_16 = ConstructPoint(XCoordinate=pdecon_2.XComponent, YCoordinate=addition_2, ZCoordinate=pdecon_2.ZComponent)
pt_17 = ConstructPoint(XCoordinate=pdecon_3.XComponent, YCoordinate=addition_3, ZCoordinate=pdecon_3.ZComponent)
panel_45 = Panel(pt_15)
dup = DuplicateData(Data=pt_14, Number="1", Order=True)  # -> graft(Data)

gradient = Gradient(LowerLimit=0, UpperLimit=1, Parameter=graph, stops=[0: RGB(0, 128, 0), 0.5: RGB(255, 255, 0), 1: RGB(255, 0, 0)])
preview = CustomPreview(Geometry=fieldpts.PTS, Material=gradient)

panel_46 = Panel(dup)
dup_2 = DuplicateData(Data=pt_13, Number="1", Order=True)  # -> graft(Data)
python = GhPythonScript(x=right, y=middle, z=left, u=additionalrotation, v=nummodule, ResetSavedValues=Button())  # -> out, Foo
# ---------- python: Python ----------
__author__ = "John_Rao"
__version__ = "2020.12.10"

import rhinoscriptsyntax as rs
foo = False
if 'last_vars' not in globals() or ResetSavedValues:
    last_vars = [x, y, z, u, v]

vars = [x, y, z, u, v]
for i in range(len(vars)):
    if vars[i] != last_vars[i]:
        foo = True
        last_vars = [x, y, z, u, v]
        break
        ghenv.Component.ExpireSolution(True)
Foo = foo
# ---------- end python ----------
panel_47 = Panel(dup_2)
entwine = Entwine(Branch00=dup, Branch01=pt_15, Branch02=pt_16, Branch03=pt_17, Branch04=dup_2, FlattenInputs=True)
toggle = BooleanToggle(False)
panel_48 = Panel(entwine)
panel_49 = Panel("""s_top>s_bott
s_top>s_bott_ROT
s_top>s_bott_90
s_top_ROT>s_bott_ROT
s_top_ROT>s_bott_90
s_top_ROT>s_bott
s_top_90>s_bott_90
s_top_90>s_bott
s_top_90>s_bott_ROT
s_ends>s_ends
s_ends>s_sideR
s_ends>s_sideL
s_sideR>s_ends
s_sideL>s_ends
s_sideL>s_sideR
s_sideR>s_sideL""")
flip = FlipMatrix(Data=panel_48)
panel_50 = Panel(python.Foo)
panel_51 = Panel(flip)
python_2 = PythonScript(CV=Slider(0.749, range=0..1))  # -> B
# ---------- python_2: Python ----------
# Make persistent value to keep track of last value
if "lastValue" not in globals():
    lastValue = CV

# Check that current value is different from last value
if lastValue == CV:
    B = False
else:
    B = True
    lastValue = CV
# ---------- end python_2 ----------
geo_2 = Geometry(<brep referenced from the Rhino model>)
panel_52 = Panel(python_2)
meshconst = Wasp_MeshConstraint(GEO=geo_2, IN=Toggle(True), SOFT=Toggle(True))  # -> GC; inputs GEO: Mesh, SOFT: Boolean; plug-in component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
multiplication = Multiplication(A=graft(performance), B="10")
nurbs = NurbsCurve(Vertices=panel_51, Degree=3, Periodic=False)  # -> Curve, Length, Domain
X_2 = UnitX(Factor=multiplication)
int = Integer(nummodule)
item_6 = ListItem(List=flatten(nurbs.Curve), Index=Slider(1, range=0..100), Wrap=True)
crv_7 = Curve(item_6)
panel_53 = Panel(nurbs.Curve)
move_23 = Move(Geometry=nurbs.Curve, Motion=X_2)  # -> Geometry, Transform
crv_8 = Curve(move_23.Geometry)
move_24 = Move(Geometry=crv_8, Motion=Y_12)  # -> Geometry, Transform
item_7 = ListItem(List=flatten(move_24.Geometry), Index=Slider(9, range=0..100), Wrap=True)
cull_i = CullIndex(List=flatten(nurbs.Curve), Indices=select_index_3, Wrap=True)
highlightedcrv = ListItem(List=flatten(nurbs.Curve), Index=select_index_3, Wrap=True)
cull_i_2 = CullIndex(List=flatten(move_23.Geometry), Indices=select_index_3, Wrap=True)
allcrv = Curve(cull_i)
end = EndPoints(Curve=move_23.Geometry)  # -> Start, End
allcrv_2 = Curve(cull_i_2)
pt_18 = Point(end.Start)
item_8 = ListItem(List=flatten(move_23.Geometry), Index=select_index_3, Wrap=True)
cir = Circle(Plane=pt_18, Radius=Slider(0.5, range=0..1))
pt_19 = ConstructPoint(XCoordinate=multiplication, YCoordinate=panel_3, ZCoordinate=0)
item_9 = ListItem(List=flatten(cir), Index=select_index_3, Wrap=True)
roperf = Circle(Plane=pt_19, Radius=Slider(0.5, range=0..1))
item_10 = ListItem(List=flatten(roperf), Index=select_index_3, Wrap=True)

# ---- group: karamba / crossSections
multiplication_2 = Multiplication(A="162", B="0.0393701")
multiplication_3 = Multiplication(A="4.5", B="0.0393701")
multiplication_4 = Multiplication(A="48", B="0.0393701")
multiplication_5 = Multiplication(A="152", B="0.0393701")
multiplication_6 = Multiplication(A="3", B="0.0393701")
multiplication_7 = Multiplication(A="4", B="0.0393701")
multiplication_8 = Multiplication(A="153", B="0.0393701")
multiplication_9 = Multiplication(A="60", B="0.0393701")
multiplication_10 = Multiplication(A="110", B="0.0393701")
multiplication_11 = Multiplication(A="6", B="0.0393701")
multiplication_12 = Multiplication(A="174", B="0.0393701")
multiplication_13 = Multiplication(A="36", B="0.0393701")
multiplication_14 = Multiplication(A="70", B="0.0393701")
multiplication_15 = Multiplication(A="206", B="0.0393701")
multiplication_16 = Multiplication(A="2", B="0.0393701")
cross_section = CrossSectionKaramba3D(
    FamilyNameOfCrossSection="DefaultCroSec",
    Material=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,
    Height_in=multiplication_8,
    UpperFlangeWidth_in=multiplication_12,
    LowerFlangeWidth_in=multiplication_12,
    UpperFlangeThickness_in=multiplication_11,
    LowerFlangeThickness_in=multiplication_11,
    SidewallsThickness_in=multiplication_11,
    FilletRadius_in=0.2362204724,
    mode="Box")
cross_section_2 = CrossSectionKaramba3D(
    FamilyNameOfCrossSection="DefaultCroSec",
    Material=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,
    Height_in=multiplication_2,
    UpperFlangeWidth_in=multiplication_4,
    LowerFlangeWidth_in=multiplication_4,
    UpperFlangeThickness_in=multiplication_3,
    LowerFlangeThickness_in=multiplication_3,
    SidewallsThickness_in=multiplication_3,
    FilletRadius_in=0.2362204724,
    mode="Box")
cross_section_3 = CrossSectionKaramba3D(
    FamilyNameOfCrossSection="DefaultCroSec",
    Material=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,
    Height_in=multiplication_13,
    UpperFlangeWidth_in=multiplication_14,
    LowerFlangeWidth_in=multiplication_15,
    UpperFlangeThickness_in=multiplication_16,
    LowerFlangeThickness_in=multiplication_16,
    SidewallsThickness_in=multiplication_16,
    FilletRadius_in=0.2362204724,
    mode="Box")
cross_section_4 = CrossSectionKaramba3D(
    FamilyNameOfCrossSection="DefaultCroSec",
    Material=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,
    Height_in=multiplication_9,
    UpperFlangeWidth_in=multiplication_9,
    LowerFlangeWidth_in=multiplication_9,
    UpperFlangeThickness_in=multiplication_6,
    LowerFlangeThickness_in=multiplication_6,
    SidewallsThickness_in=multiplication_6,
    FilletRadius_in=0.2362204724,
    mode="Box")
cross_section_5 = CrossSectionKaramba3D(
    FamilyNameOfCrossSection="DefaultCroSec",
    Material=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,
    Height_in=multiplication_5,
    UpperFlangeWidth_in=multiplication_10,
    LowerFlangeWidth_in=multiplication_10,
    UpperFlangeThickness_in=multiplication_7,
    LowerFlangeThickness_in=multiplication_7,
    SidewallsThickness_in=multiplication_7,
    FilletRadius_in=0.2362204724,
    mode="Box")

# ---- group: voidConstraint / VoidScaleVaribles
bottom = Slider(2, range=0.5..2)  # disabled
top = Slider(1, range=0.5..2)  # disabled

# ----
crv_9 = Curve(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)  # disabled
cp_2 = ControlPoints(Curve=crv_9)  # -> Points, Weights, Knots; disabled
number_slider_2 = Slider(1.9, range=-5..5)  # disabled
number_slider_3 = Slider(-1.02, range=-5..5)  # disabled
number_slider_4 = Slider(-2.8, range=-5..5)  # disabled
item_11 = ListItem(List=cp_2.Points, Index=0, Wrap=True)  # -> Item, Item1, Item2, Item3, Item4; disabled
pt_20 = Point(item_11.Item)  # disabled
pt_21 = Point(item_11.Item3)  # disabled
pt_22 = Point(item_11.Item1)  # disabled
pt_23 = Point(item_11.Item2)  # disabled
pt_24 = Point(item_11.Item4)  # disabled
Y_14 = UnitY(Factor=number_slider_3)  # disabled
Y_15 = UnitY(Factor=number_slider_2)  # disabled
Y_16 = UnitY(Factor=number_slider_4)  # disabled
pdeform_2 = PointDeform(Geometry=crv_9, Points=[pt_22, pt_23, pt_21], Motion=[Y_14, Y_15, Y_16])  # disabled
pl_3pt = Plane3Pt(PointA=Point(-37.64164115, 20, 40), PointB=Point(-37.64164115, 20, 0), PointC=Point(-17.64164115, 20, 0))  # disabled
mirror = Mirror(Geometry=pdeform_2, Plane=pl_3pt)  # -> Geometry, Transform; disabled
end_2 = EndPoints(Curve=pdeform_2)  # -> Start, End; disabled
end_3 = EndPoints(Curve=mirror.Geometry)  # -> Start, End; disabled
ln = Line(StartPoint=end_3.Start, EndPoint=end_2.Start)  # disabled
ln_2 = Line(StartPoint=end_3.End, EndPoint=end_2.End)  # disabled
number_slider_5 = Slider(40, range=0..100)  # disabled
join = JoinCurves(Curves=[pdeform_2, ln, ln_2, mirror.Geometry], Preserve=False)  # disabled
X_3 = UnitX(Factor=number_slider_5)  # disabled
extr = Extrude(Base=join, Direction=X_3)  # disabled
cap = CapHoles(Brep=extr)  # disabled
faceb = FaceBoundaries(Mesh=cap)  # disabled
geo_3 = Geometry(cap)  # disabled

# ---- group: globalConstraints / ProfileCrvVariable
number_slider_6 = Slider(10, range=-10..10)  # disabled
number_slider_7 = Slider(0, range=-10..10)  # disabled
number_slider_8 = Slider(0, range=-10..10)  # disabled

# ---- group: volumetric
geo_4 = Geometry(<brep referenced from the Rhino model>)  # disabled
number_slider_9 = Slider(4, range=0..40)  # disabled
fieldpts_2 = Wasp_FieldPoints(BOU=geo_4, RES=number_slider_9)  # -> E_FIELD, PTS; inputs BOU: list of Mesh; disabled; plug-in component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
pull_2 = PullPoint(Point=fieldpts_2.PTS, Geometry=geo_4, ClosestOnly=True)  # -> ClosestPoint, Distance; disabled
bnd_2 = Bounds(Numbers=pull_2.Distance)  # disabled
remap_2 = RemapNumbers(Value=pull_2.Distance, Source=bnd_2, Target=Domain(0, 1))  # -> Mapped, Clipped; disabled
graph_2 = GraphMapper(
    remap_2.Mapped,
    x0=0,
    x1=1,
    y0=0,
    y1=1,
    container_name="Bezier",
    cpx=[0, 0.07480690628, 0.1864679456, 1],
    cpy=[0, 0.9544659853, 1, 1])  # disabled
panel_54 = Panel("originalVolume")  # disabled
field_2 = Wasp_Field(NAME=panel_54, E_FIELD=fieldpts_2.E_FIELD, VAL=graph_2)  # -> FIELD; inputs VAL: list; disabled; plug-in component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
defield = Wasp_DeconstructField(FIELD=field_2)  # -> NAME, RES, BOU, PTS, VAL, COUNT; disabled; plug-in component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
gradient_2 = Gradient(LowerLimit=0, UpperLimit=1, Parameter=defield.VAL, stops=[0: RGB(0, 128, 0), 0.508: RGB(255, 255, 0), 1: RGB(255, 0, 0)])  # disabled
preview_2 = CustomPreview(Geometry=defield.PTS, Material=gradient_2)  # disabled

# ---- group: voidConstraint
voidbott = Curve(<curve referenced from the Rhino model>)  # disabled
voidtop = Curve(<curve referenced from the Rhino model>)  # disabled
area_6 = Area(Geometry=voidbott)  # -> Area, Centroid; disabled
area_7 = Area(Geometry=voidtop)  # -> Area, Centroid; disabled
scale = Scale(Geometry=voidtop, Center=area_7.Centroid, Factor=top)  # -> Geometry, Transform; disabled
scale_2 = Scale(Geometry=voidbott, Center=area_6.Centroid, Factor=bottom)  # -> Geometry, Transform; disabled
loft = Loft(
    Curves=[scale_2.Geometry, scale.Geometry],
    Options={Adjust=False, Closed=False, LoftEnds=0, LoftSimp=0, LoftType=0, Rebuild=10, Refit=0.01})  # disabled
cap_2 = CapHoles(Brep=loft)  # disabled
mesh = MeshBrep(
    Brep=cap_2,
    Settings={GridMaxCount=0, GridMinCount=16, JaggedSeams=False, MaxEdgeLength=0, MinEdgeLength=0.0001, MinTolerance=0, Refine=True, RefineAngle=0, RelativeTolerance=0.65, SimplePlanes=True, Tolerance=0})  # disabled
faceb_2 = FaceBoundaries(Mesh=mesh)  # disabled
toggle_2 = BooleanToggle(False)  # disabled
toggle_3 = BooleanToggle(False)  # disabled
meshconst_2 = Wasp_MeshConstraint(GEO=mesh, IN=toggle_2, SOFT=toggle_3)  # -> GC; inputs GEO: Mesh, SOFT: Boolean; disabled; plug-in component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

# ---- group: globalConstraints
profile = Curve(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)  # disabled
bottcs = Curve(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)  # disabled
topcs = Curve(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)  # disabled
cp_3 = ControlPoints(Curve=profile)  # -> Points, Weights, Knots; disabled
item_12 = ListItem(List=cp_3.Points, Index=0, Wrap=True)  # -> Item, Item1, Item2, Item3, Item4; disabled
pt_25 = Point(item_12.Item)  # disabled
pt_26 = Point(item_12.Item3)  # disabled
pt_27 = Point(item_12.Item1)  # disabled
pt_28 = Point(item_12.Item2)  # disabled
pt_29 = Point(item_12.Item4)  # disabled
Y_17 = UnitY(Factor=number_slider_6)  # disabled
Y_18 = UnitY(Factor=number_slider_7)  # disabled
Y_19 = UnitY(Factor=number_slider_8)  # disabled
move_25 = Move(Geometry=pt_26, Motion=Y_17)  # -> Geometry, Transform; disabled
move_26 = Move(Geometry=pt_28, Motion=Y_18)  # -> Geometry, Transform; disabled
move_27 = Move(Geometry=pt_27, Motion=Y_19)  # -> Geometry, Transform; disabled
pt_30 = Point([pt_29, move_25.Geometry, move_26.Geometry, move_27.Geometry, pt_25])  # disabled
sort_pt = SortPoints(Points=pt_30)  # -> Points, Indices; disabled
nurbs_2 = NurbsCurve(Vertices=sort_pt.Points, Degree=3, Periodic=False)  # -> Curve, Length, Domain; disabled
pl_3pt_2 = Plane3Pt(PointA=Point(7.358358853, 20, 40), PointB=Point(-42.64164115, 20, 40), PointC=Point(7.358358853, 20, 0))  # disabled
mirror_2 = Mirror(Geometry=nurbs_2.Curve, Plane=pl_3pt_2)  # -> Geometry, Transform; disabled
swp2 = Sweep2(Rail1=nurbs_2.Curve, Rail2=mirror_2.Geometry, Sections=[bottcs, topcs], SameHeight=False)  # disabled
cap_3 = CapHoles(Brep=swp2)  # disabled
mesh_2 = MeshBrep(
    Brep=cap_3,
    Settings={GridMaxCount=0, GridMinCount=16, JaggedSeams=False, MaxEdgeLength=0, MinEdgeLength=0.0001, MinTolerance=0, Refine=True, RefineAngle=0, RelativeTolerance=0.65, SimplePlanes=True, Tolerance=0})  # disabled
faceb_3 = FaceBoundaries(Mesh=mesh_2)  # disabled
toggle_4 = BooleanToggle(True)  # disabled
toggle_5 = BooleanToggle(True)  # disabled
meshconst_3 = Wasp_MeshConstraint(GEO=mesh_2, IN=toggle_4, SOFT=toggle_5)  # -> GC; inputs GEO: Mesh, SOFT: Boolean; disabled; plug-in component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

# ---- group: stackingTest
brep_2 = Brep(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)  # disabled
number_slider_10 = Slider(9.5, range=0..10)  # disabled
number_slider_11 = Slider(3, range=0..10)  # disabled
number_slider_12 = Slider(0, range=0..100)  # disabled
series = Series(Start=0, Step=number_slider_10, Count=number_slider_11)  # disabled
Z_6 = UnitZ(Factor=series)  # disabled
number_slider_13 = Slider(7, range=0..100)  # disabled
Y_20 = UnitY(Factor=number_slider_12)  # disabled
move_28 = Move(Geometry=brep_2, Motion=Z_6)  # -> Geometry, Transform; disabled
item_13 = ListItem(List=move_28.Geometry, Index=1, Wrap=True)  # disabled
item_14 = ListItem(List=move_28.Geometry, Index=0, Wrap=True)  # disabled
item_15 = ListItem(List=move_28.Geometry, Index=2, Wrap=True)  # disabled
move_29 = Move(Geometry=item_13, Motion=Y_20)  # -> Geometry, Transform; disabled
area_8 = Area(Geometry=move_29.Geometry)  # -> Area, Centroid; disabled
rot3d = Rotate3D(Geometry=move_29.Geometry, Angle=number_slider_13, Center=area_8.Centroid, Axis=Vector(0, 0, 1))  # -> Geometry, Transform; disabled
merge_7 = Merge(Data1=item_14, Data2=rot3d.Geometry, Data3=item_15)  # disabled

# ---- group: optimization
goat = Goat(fitness=num, gene=[left, right, middle, additionalrotation])

# ---- group: boot_conn
Y_21 = UnitY(Factor=Slider(5, range=0..10))
Y_22 = UnitY(Factor=Slider(7.5, range=0..10))
Y_23 = UnitY(Factor=Slider(2.5, range=0..10))
neg_13 = Negative(Value=Y_22)
neg_14 = Negative(Value=Y_21)
neg_15 = Negative(Value=Y_23)
area_9 = Area(Geometry=item.Item2)  # -> Area, Centroid
move_30 = Move(Geometry=area_9.Centroid, Motion=neg_13)  # -> Geometry, Transform
move_31 = Move(Geometry=area_9.Centroid, Motion=neg_14)  # -> Geometry, Transform
move_32 = Move(Geometry=area_9.Centroid, Motion=neg_15)  # -> Geometry, Transform
move_33 = Move(Geometry=area_9.Centroid, Motion=Y_23)  # -> Geometry, Transform
move_34 = Move(Geometry=area_9.Centroid, Motion=Y_21)  # -> Geometry, Transform
move_35 = Move(Geometry=area_9.Centroid, Motion=Y_22)  # -> Geometry, Transform
line_24 = LineSDL(Start=move_33.Geometry, Direction=Y_2, Length=number_slider)
line_25 = LineSDL(Start=move_35.Geometry, Direction=Y_2, Length=number_slider)
line_26 = LineSDL(Start=move_31.Geometry, Direction=Y_2, Length=number_slider)
line_27 = LineSDL(Start=move_32.Geometry, Direction=Y_2, Length=number_slider)
line_28 = LineSDL(Start=move_34.Geometry, Direction=Y_2, Length=number_slider)
line_29 = LineSDL(Start=move_30.Geometry, Direction=Y_2, Length=number_slider)
line_30 = LineSDL(Start=area_9.Centroid, Direction=Y_2, Length=number_slider)
merge_8 = Merge(Data1=line_29, Data2=line_26, Data3=line_27, Data4=line_30, Data5=line_24, Data6=line_28, Data7=line_25)
merge_9 = Merge(
    Data1=move_30.Geometry,
    Data2=move_31.Geometry,
    Data3=move_32.Geometry,
    Data4=area_9.Centroid,
    Data5=move_33.Geometry,
    Data6=move_34.Geometry,
    Data7=move_35.Geometry)
pt_31 = Point([move_31.Geometry, area_9.Centroid, move_34.Geometry])

# ----
crv_10 = Curve([line_26, line_30, line_28])

# ---- group: boot_conn (continued)
conndir_5 = Wasp_ConnectionFromDirection(GEO=geo, CEN=pt_31, UP=crv_10, T="s_bott")  # -> CONN, PLN_OUT; inputs CEN: list of Point3d, UP: list of Curve, T: list; plug-in component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

# ---- group: 90DegreePlane_conn
number_slider_14 = Slider(90, range=0..100)
prot = RotatePlane(Plane=conndir_5.PLN_OUT, Angle=degrees(number_slider_14))
prot_2 = RotatePlane(Plane=conndir.PLN_OUT, Angle=degrees(number_slider_14))
connpln = Wasp_ConnectionFromPlane(PLN=prot, T="s_bott_90")  # -> CONN, PLN_OUT; inputs PLN: list of Plane, T: list; plug-in component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
connpln_2 = Wasp_ConnectionFromPlane(PLN=prot_2, T="s_top_90")  # -> CONN, PLN_OUT; inputs PLN: list of Plane, T: list; plug-in component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

# ---- group: freeRot_conn
prot_3 = RotatePlane(Plane=conndir_5.PLN_OUT, Angle=degrees(additionalrotation))
prot_4 = RotatePlane(Plane=conndir.PLN_OUT, Angle=degrees(additionalrotation))
connpln_3 = Wasp_ConnectionFromPlane(PLN=prot_3, T="s_bott_ROT")  # -> CONN, PLN_OUT; inputs PLN: list of Plane, T: list; plug-in component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
connpln_4 = Wasp_ConnectionFromPlane(PLN=prot_4, T="s_top_ROT")  # -> CONN, PLN_OUT; inputs PLN: list of Plane, T: list; plug-in component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

# ----
merge_10 = Merge(
    Data1=conndir_3.CONN,
    Data2=conndir_4.CONN,
    Data3=conndir_5.CONN,
    Data4=connpln.CONN,
    Data5=conndir_2.CONN,
    Data6=conndir.CONN,
    Data7=connpln_2.CONN,
    Data8=connpln_3.CONN,
    Data9=connpln_4.CONN)

# ---- group: support_constraints
number_slider_15 = Slider(5, range=0..10)
Z_7 = UnitZ(Factor=1)
Z_8 = UnitZ(Factor=1)
Z_9 = UnitZ(Factor=1)
neg_16 = Negative(Value=Z_7)
neg_17 = Negative(Value=Z_8)
neg_18 = Negative(Value=Z_9)
line_31 = LineSDL(Start=move_32.Geometry, Direction=[neg_16, Z_7], Length=number_slider_15)
line_32 = LineSDL(Start=move_33.Geometry, Direction=[neg_16, Z_7], Length=number_slider_15)
line_33 = LineSDL(Start=move_30.Geometry, Direction=[neg_16, Z_7], Length=number_slider_15)
line_34 = LineSDL(Start=move_35.Geometry, Direction=[neg_16, Z_7], Length=number_slider_15)
line_35 = LineSDL(Start=move_31.Geometry, Direction=[neg_16, Z_7], Length=number_slider_15)
line_36 = LineSDL(Start=area_9.Centroid, Direction=[neg_17, Z_8], Length=Slider(5, range=0..10))
line_37 = LineSDL(Start=move_34.Geometry, Direction=[neg_18, Z_9], Length=Slider(5, range=0..10))
join_2 = JoinCurves(Curves=line_31, Preserve=False)
join_3 = JoinCurves(Curves=line_32, Preserve=False)
join_4 = JoinCurves(Curves=line_34, Preserve=False)
join_5 = JoinCurves(Curves=line_33, Preserve=False)
join_6 = JoinCurves(Curves=line_36, Preserve=False)
join_7 = JoinCurves(Curves=line_35, Preserve=False)
join_8 = JoinCurves(Curves=line_37, Preserve=False)
support = Wasp_Support(DIR=[join_2, join_6, join_8, join_3, join_4], GEO=geo)  # -> SUP; inputs DIR: list of Curve, GEO: Mesh; plug-in component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
support_2 = Wasp_Support(DIR=[join_3, join_6, join_7, join_2, join_5], GEO=geo)  # -> SUP; inputs DIR: list of Curve, GEO: Mesh; plug-in component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
support_3 = Wasp_Support(DIR=[join_8, join_4, join_5, join_7], GEO=geo)  # -> SUP; inputs DIR: list of Curve, GEO: Mesh; plug-in component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

# ----
support_4 = Wasp_Support(DIR=[join_2, join_7, join_6, join_8, join_3], GEO=geo)  # -> SUP; inputs DIR: list of Curve, GEO: Mesh; plug-in component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

# ---- group: support_constraints (continued)
merge_11 = Merge(Data1=support_3, Data2=support, Data3=support_2, Data4=support_4)

# ----
support_5 = Wasp_Support(DIR=[join_7, join_6], GEO=geo)  # -> SUP; inputs DIR: list of Curve, GEO: Mesh; plug-in component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
support_6 = Wasp_Support(DIR=[join_8, join_6], GEO=geo)  # -> SUP; inputs DIR: list of Curve, GEO: Mesh; plug-in component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
support_7 = Wasp_Support(DIR=[join_7, join_8], GEO=geo)  # -> SUP; inputs DIR: list of Curve, GEO: Mesh; plug-in component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
merge_12 = Merge(Data1=support_5, Data2=support_7, Data3=support_6)
advpart = Wasp_AdvancedPart(NAME="s", GEO=geo, CONN=flatten(merge_10), SUP=merge_12)  # -> PART; inputs GEO: Mesh, CONN: list, COLL: Mesh, HI: list, ATTR: list, SUP: list; plug-in component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

# ---- group: base
series_2 = Series(Start=0, Step=Slider(8, range=0..10), Count=Slider(10, range=0..10))
X_4 = UnitX(Factor=series_2)
move_36 = Move(Motion=X_4)  # -> Geometry, Transform
series_3 = Series(Start=0, Step=Slider(20, range=0..100), Count=Slider(4, range=0..10))
parttr = Wasp_TransformPart(PART=advpart, TR=move_36.Transform)  # -> PART_OUT; plug-in component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
Y_24 = UnitY(Factor=series_3)
move_37 = Move(Motion=Y_24)  # -> Geometry, Transform
parttr_2 = Wasp_TransformPart(PART=graft(parttr), TR=move_37.Transform)  # -> flatten(PART_OUT); plug-in component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
partgeo = Wasp_GetPartGeometry(PART=parttr_2)  # -> GEO; plug-in component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

# ----
rulegen = Wasp_RulesGenerator(PART=advpart, GR=panel_49)  # -> R; inputs PART: list, SELF_P: Boolean, SELF_C: Boolean, TYP: Boolean, GR: list; plug-in component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

# ---- group: stochasticAggregation
panel_55 = Panel("3")
stochasticaggregation = Wasp_StochasticAggregation(PART=flatten(advpart), PREV=parttr_2, N=nummodule, RULES=rulegen, MODE=panel_55, GC=meshconst, RESET=Button())  # -> AGGR, PART_OUT; inputs PART: list, PREV: list, N: Int32, RULES: list, MODE: Int32, GC: list, RESET: Boolean; plug-in component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
lng = ListLength(List=parttr_2)
split_9 = SplitList(List=stochasticaggregation.PART_OUT, Index=lng)  # -> ListA, flatten(ListB)
partgeo_2 = Wasp_GetPartGeometry(PART=split_9.ListB)  # -> GEO; plug-in component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
preview_3 = CustomPreview(Geometry=partgeo_2, Material=ColourSwatch(SwatchColor=RGB(255, 160, 71)))

# ---- group: fieldDriven
button = Button()
fieldaggregation = Wasp_FieldDrivenAggregation(PART=flatten(advpart), PREV=parttr_2, N=nummodule, RULES=rulegen, FIELD=field, MODE=panel_55, RESET=python.Foo)  # -> AGGR, PART_OUT; inputs PART: list, PREV: list, N: Int32, RULES: list, FIELD: list, MODE: Int32, GC: list, RESET: Boolean; plug-in component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
lng_2 = ListLength(List=parttr_2)
split_10 = SplitList(List=fieldaggregation.PART_OUT, Index=lng_2)  # -> ListA, ListB
partgeo_3 = Wasp_GetPartGeometry(PART=split_10.ListA)  # -> GEO; plug-in component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
partgeo_4 = Wasp_GetPartGeometry(PART=split_10.ListB)  # -> GEO; plug-in component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
preview_4 = CustomPreview(Geometry=partgeo_3, Material=ColourSwatch(SwatchColor=RGB(227, 214, 202)))
preview_5 = CustomPreview(Geometry=partgeo_4, Material=ColourSwatch(SwatchColor=RGBA(41, 128, 204, 220)))

# ----
lng_3 = ListLength(List=partgeo_4)

# ---- group: rebuildingBrep
faceb_4 = FaceBoundaries(Mesh=partgeo_4)
item_16 = ListItem(List=faceb_4, Index="31", Wrap=True)
number_slider_16 = Slider(1, range=0..1)
planesrf = PlaneSurface(Plane=item_16, XSize=number_slider_16, YSize=number_slider_16)
bbox_2 = BoundingBox(Content=graft(partgeo_4), Plane=planesrf, UnionBox=False)  # -> Box, Box_2
brep_3 = Brep(bbox_2.Box)

# ----
subtraction = Subtraction(A=lng_3, B=int)
abs = Absolute(Value=subtraction)

# ---- group: optimization (continued)
panel_56 = Panel(abs)

# ---- group: karamba
debrep_2 = DeconstructBrep(Brep=flatten(brep_3))  # -> Faces, Edges, Vertices
item_17 = ListItem(List=debrep_2.Edges, Index=0, Wrap=True)  # -> Item, Item1, Item2, Item3, Item4, Item5, Item6, Item7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
number_slider_17 = Slider(17, range=0..20)
panel_57 = Panel("36")
toggle_6 = BooleanToggle(True)
linetobeamreinfor = LineToBeamKaramba3D(CrossSection=cross_section_4, New=True, Remove=True, LimitDistance_ft=0.005, Bending=toggle_6)  # -> Element, Points, Info; disabled

# ----
crv_11 = Curve(item_17.Item)
crv_12 = Curve(item_17.Item2)
crv_13 = Curve(item_17.Item6)
crv_14 = Curve(item_17.Item4)

# ---- group: karamba / LongHorizontals
crv_15 = Curve(crv_11)
crv_16 = Curve(crv_14)
crv_17 = Curve(crv_13)
crv_18 = Curve(crv_12)

# ----
crv_19 = Curve(item_17.Item1)
crv_20 = Curve(item_17.Item5)
crv_21 = Curve(item_17.Item3)
crv_22 = Curve(item_17.Item7)

# ---- group: karamba / ShortHorizontals
crv_23 = Curve(crv_20)
crv_24 = Curve(crv_22)
crv_25 = Curve(crv_19)
crv_26 = Curve(crv_21)

# ----
crv_27 = Curve(item_17.Item11)
crv_28 = Curve(item_17.Item10)
crv_29 = Curve(item_17.Item8)
crv_30 = Curve(item_17.Item9)

# ---- group: karamba / CornerVerticals
crv_31 = Curve(crv_29)
crv_32 = Curve(crv_28)
crv_33 = Curve(crv_27)
crv_34 = Curve(crv_30)

# ---- group: karamba (continued)
merge_13 = Merge(Data1=crv_31, Data2=crv_34, Data3=crv_32, Data4=crv_33)
merge_14 = Merge(Data1=crv_25, Data2=crv_26, Data3=crv_23, Data4=crv_24)
divide = DivideCurve(Curve=crv_18, Count=number_slider_17, Kinks=False)  # -> Points, Tangents, Parameters
shatter = Shatter(Curve=crv_18, Parameters=divide.Parameters)
divide_2 = DivideCurve(Curve=crv_17, Count=number_slider_17, Kinks=False)  # -> Points, Tangents, Parameters
shatter_2 = Shatter(Curve=crv_17, Parameters=divide_2.Parameters)
divide_3 = DivideCurve(Curve=crv_16, Count=number_slider_17, Kinks=False)  # -> Points, Tangents, Parameters
shatter_3 = Shatter(Curve=crv_16, Parameters=divide_3.Parameters)
divide_4 = DivideCurve(Curve=crv_15, Count=number_slider_17, Kinks=False)  # -> Points, Tangents, Parameters
shatter_4 = Shatter(Curve=crv_15, Parameters=divide_4.Parameters)
subset = SubList(List=divide_2.Points, Domain="1 to 16", Wrap=True)  # -> List, Index
subset_2 = SubList(List=divide_4.Points, Domain="1 to 16", Wrap=True)  # -> List, Index
subset_3 = SubList(List=divide.Points, Domain="1 to 16", Wrap=True)  # -> List, Index
subset_4 = SubList(List=divide_3.Points, Domain="1 to 16", Wrap=True)  # -> List, Index
sort_pt_2 = SortPoints(Points=subset_3.List)  # -> Points, Indices
sort_pt_3 = SortPoints(Points=subset_2.List)  # -> Points, Indices
sort_pt_4 = SortPoints(Points=subset_4.List)  # -> Points, Indices
sort_pt_5 = SortPoints(Points=subset.List)  # -> Points, Indices
crv_35 = Curve(shatter_4)
crv_36 = Curve(shatter_3)
crv_37 = Curve(shatter)
crv_38 = Curve(shatter_2)
merge_15 = Merge(Data1=crv_37, Data2=crv_38)
merge_16 = Merge(Data1=crv_35, Data2=crv_36)
linetobeamfh = LineToBeamKaramba3D(Line=[crv_23, crv_24], CrossSection=cross_section_4, New=True, Remove=True, LimitDistance_ft=0.005, Bending=toggle_6)  # -> Element, Points, Info; disabled
linetobeambsr = LineToBeamKaramba3D(Line=merge_16, CrossSection=cross_section_2, New=True, Remove=True, LimitDistance_ft=0.005, Bending=toggle_6)  # -> Element, Points, Info; disabled
linetobeamfcp = LineToBeamKaramba3D(Line=merge_13, CrossSection=cross_section, New=True, Remove=True, LimitDistance_ft=0.005, Bending=toggle_6)  # -> Element, Points, Info
linetobeamfs = LineToBeamKaramba3D(Line=[crv_26, crv_25], CrossSection=cross_section_5, New=True, Remove=True, LimitDistance_ft=0.005, Bending=toggle_6)  # -> Element, Points, Info; disabled

# ---- group: karamba / VerticalReinforcements
ln_3 = Line(StartPoint=sort_pt_5.Points, EndPoint=sort_pt_2.Points)
ln_4 = Line(StartPoint=sort_pt_3.Points, EndPoint=sort_pt_4.Points)
merge_17 = Merge(Data1=ln_4, Data2=ln_3)

# ---- group: karamba / HorizontalReinforcements
ln_5 = Line(StartPoint=sort_pt_3.Points, EndPoint=sort_pt_2.Points)
ln_6 = Line(StartPoint=sort_pt_4.Points, EndPoint=sort_pt_5.Points)
merge_18 = Merge(Data1=ln_5, Data2=ln_6)

# ----
item_18 = ListItem(List=divide.Points, Index=17, Wrap=True)
item_19 = ListItem(List=divide.Points, Index=0, Wrap=True)
item_20 = ListItem(List=divide_2.Points, Index=0, Wrap=True)
item_21 = ListItem(List=divide_2.Points, Index=17, Wrap=True)

# ---- group: karamba / supporPositions
item_22 = ListItem(List=divide_4.Points, Index=17, Wrap=True)
item_23 = ListItem(List=divide_4.Points, Index=0, Wrap=True)
item_24 = ListItem(List=divide_3.Points, Index=17, Wrap=True)
item_25 = ListItem(List=divide_3.Points, Index=0, Wrap=True)
srf = Surface(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)
merge_19 = Merge(Data1=item_25, Data2=item_24, Data3=item_23, Data4=item_22, Data5=item_20, Data6=item_21, Data7=item_19, Data8=item_18)
cp_4 = PlaneClosestPoint(Point=merge_19, Plane=srf)  # -> Point, UVPoint, Distance
round = Round(Number=cp_4.Distance)  # -> Nearest, Floor, Ceiling
equals = Equality(FirstNumber=round.Nearest, SecondNumber="0")  # -> Equality, Inequality
dispatch = Dispatch(List=merge_19, DispatchPattern=equals.Equality)  # -> ListA, ListB
support_pos = Point(flatten(dispatch.ListA))

# ----
rdpoints = RemoveDuplicatePointsKaramba3D(Point=flatten(support_pos), LimitDistance=0.005)  # -> OutPoint, Info, Indexes

# ---- group: karamba / loadCalculation
loadpoint = Point([divide_2.Points, divide_3.Points])
multiplication_17 = Multiplication(A="2300", B="2.2")
division = Division(A=multiplication_17, B=panel_57)

# ---- group: karamba (continued)
division_2 = Division(A=division, B="1000")
llinter = LineLineIntersectionKaramba3D(Line=flatten([merge_15, merge_16, merge_14, merge_18]), LimitDistance_ft=0.005)  # -> IntersectionPoints, LineSubSegements
rdlines = RemoveDuplicateLinesKaramba3D(Line=flatten(llinter.LineSubSegements), LimitDistance=0.005)  # -> OutLine, Info, Indexes
linetobeamreinforv = LineToBeamKaramba3D(Line=merge_17, CrossSection=cross_section_3, New=True, Remove=True, LimitDistance_ft=0.005, Bending=Toggle(True))  # -> Element, Points, Info
linetobeamtsr = LineToBeamKaramba3D(Line=rdlines.OutLine, CrossSection=cross_section_4, New=True, Remove=True, LimitDistance_ft=0.005, Bending=toggle_6)  # -> Element, Points, Info
supp = SupportKaramba3D(PosInd=rdpoints.OutPoint, menu=[buttons(on, on, on, on, on, on)])
merge_20 = Merge(Data1=linetobeamfcp.Element, Data3=linetobeamtsr.Element, Data5=linetobeamreinforv.Element)  # -> flatten(Result)

# ---- group: karamba / loadCalculation (continued)
Z_10 = UnitZ(Factor=division_2)
neg_19 = Negative(Value=Z_10)

# ---- group: karamba (continued)
loads = LoadsKaramba3D(ForceVector=neg_19, Local=False, PosInd=loadpoint, LCase=0, mode="Point")
assemble = AssembleModelKaramba3D(Elem=flatten(merge_20), Support=flatten(supp), Load=flatten(loads), LimitDistance_ft=0.005)  # -> Model, Info, Mass_lbm, CenterOfGravity
analyze = AnalyzeKaramba3D(Model=assemble.Model)  # -> CalculatedModel, MaximumDisplacement_in, ResultingForceOfGravity_kips, ElasticEnergy_kip_ft; disabled
modelview = ModelViewKaramba3D(Model=analyze.CalculatedModel, ResultFactors=1, ResultCase=-1)  # -> Model, DeformedMesh, DeformedAxes, DeformedModel
beamview = BeamViewKaramba3D(Model=modelview.Model)  # -> Model, MeshesOfRenderedBeams, DeformedBeamAxes, flatten(LegendColors), flatten(LegendTags)

# ---- group: optimization (continued)
panel_58 = Panel(analyze.ElasticEnergy_kip_ft)
addition_4 = Addition(A=panel_58, B=panel_56)
num = Number(addition_4)
panel_59 = Panel(num)

# ----
capture = Capture(
    Variables=[additionalrotation, right, left, middle],
    Objectives=num,
    Mode=2,
    Properties=panel_56,
    DesignMap=panel_32,
    CsvFilename="SamplegHyper_25_40Rot4Capture",
    CsvDirectory=panel_35,
    ScreenshotFilename="sampleH7",
    ScreenshotDirectory=panel_34,
    BackupFrequency=0)  # -> DesignMapObjectives, CapturedProperties, Data, Images, Index
panel_60 = Panel(capture.CapturedProperties)
panel_61 = Panel(capture.DesignMapObjectives)
split_11 = SplitList(List=panel_61, Index=4)  # -> ListA, ListB
