# Grasshopper definition modularizerFinalPrototype.gh (Grasshopper 1.0.7)
# plug-ins: Capture, Sift, Sampler, karambaGH, goat

cluster = Cluster()

# ---- group: design variables / rotationVar
additionalrotation = Slider(45, range=0..89)

# ---- group: design variables
nummodule = Slider(25, range=5..30)

# ---- group: design variables / profileCrvVar
middle = Slider(4.75, range=-15..15)
left = Slider(6.78, range=-15..15)
right = Slider(-11.25, range=-15..15)

# ---- group: design inputs
modulebrep = Brep(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)
profilecrv = Curve(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)

# ----
license = LicenseKaramba3D()

# ---- group: design generation
aggregationpartsetup = AggregationPartSetup(brep=modulebrep, additionalrotation=additionalrotation)
basesetup = BaseSetup(part=aggregationpartsetup)
cluster_2 = Cluster_2(C=profilecrv, F=right, F_2=left, F_3=middle)
python = GhPythonScript(x=right, y=middle, z=left, u=additionalrotation, v=nummodule, ResetSavedValues=Button())  # -> out, reset
# ---------- python: Python ----------
__author__ = "John_Rao"
__version__ = "2020.12.10"

import rhinoscriptsyntax as rs
foo = False
if 'last_vars' not in globals() or ResetSavedValues:
    last_vars = [x, y, z, u, v]

vars = [x, y, z, u, v]
for i in range(len(vars)):
    if vars[i] != last_vars[i]:
        foo = True
        last_vars = [x, y, z, u, v]
        break
        ghenv.Component.ExpireSolution(True)
Foo = foo
# ---------- end python ----------
panel = Panel("""s_top>s_bott
s_top>s_bott_ROT
s_top>s_bott_90
s_top_ROT>s_bott_ROT
s_top_ROT>s_bott_90
s_top_ROT>s_bott
s_top_90>s_bott_90
s_top_90>s_bott
s_top_90>s_bott_ROT
s_ends>s_ends
s_ends>s_sideR
s_ends>s_sideL
s_sideR>s_ends
s_sideL>s_ends
s_sideL>s_sideR
s_sideR>s_sideL""")
rulegen = Wasp_RulesGenerator(PART=aggregationpartsetup, GR=panel)  # -> R; inputs PART: list, SELF_P: Boolean, SELF_C: Boolean, TYP: Boolean, GR: list; plug-in component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
aggregationgeneration = AggregationGeneration(
    part=aggregationpartsetup,
    prev=basesetup,
    N=nummodule,
    rules=rulegen,
    field=cluster_2,
    reset=python.reset,
    baselist=basesetup)

# ----
preview = CustomPreview(Geometry=aggregationgeneration, Material=ColourSwatch(SwatchColor=RGB(41, 128, 204)))

# ---- group: rebuildingBrep
faceb = FaceBoundaries(Mesh=aggregationgeneration)
item = ListItem(List=faceb, Index="31", Wrap=True)
number_slider = Slider(1, range=0..1)
planesrf = PlaneSurface(Plane=item, XSize=number_slider, YSize=number_slider)
bbox = BoundingBox(Content=graft(aggregationgeneration), Plane=planesrf, UnionBox=False)  # -> Box, Box_2
brep = Brep(bbox.Box)

# ---- group: structural analysis
structuralmodelsetup = StructuralModelSetup(breps=brep)  # -> elements, load, supports
assemble = AssembleModelKaramba3D(
    Elem=flatten(structuralmodelsetup.elements),
    Support=flatten(structuralmodelsetup.supports),
    Load=flatten(structuralmodelsetup.load),
    LimitDistance_ft=0.005)  # -> Model, Info, Mass_lbm, CenterOfGravity
analyze = AnalyzeKaramba3D(Model=assemble.Model)  # -> CalculatedModel, MaximumDisplacement_in, ResultingForceOfGravity_kips, ElasticEnergy_kip_ft
panel_2 = Panel(analyze.ElasticEnergy_kip_ft)
modelview = ModelViewKaramba3D(Model=analyze.CalculatedModel, ResultFactors=1, ResultCase=-1)  # -> Model, DeformedMesh, DeformedAxes, DeformedModel
beamview = BeamViewKaramba3D(Model=modelview.Model)  # -> Model, MeshesOfRenderedBeams, DeformedBeamAxes, flatten(LegendColors), flatten(LegendTags)

# ---- group: optimization
numdesired = Integer(nummodule)
numplaced = ListLength(List=aggregationgeneration)
goat = Goat(fitness=num, gene=[left, right, middle, additionalrotation])
subtraction = Subtraction(A=numplaced, B=numdesired)
abs = Absolute(Value=subtraction)
panel_3 = Panel(abs)
addition = Addition(A=analyze.ElasticEnergy_kip_ft, B=abs)
num = Number(addition)
panel_4 = Panel(num)

# ---- group: sampling
panel_5 = Panel("C:\Users\John Rao\Dropbox (MIT)\MIT_Work\4.451\Project\Presentation\Final\Sampling")
sampler = Sampler(
    Variables=[additionalrotation, right, left, middle],
    Samples="60",
    Type="2",
    Seed="0",
    Filename="SamplegHyper_25_40Rot4",
    Directory=panel_5)  # -> DesignMap, Data
panel_6 = Panel(sampler.DesignMap)
panel_7 = Panel(sampler.DesignMap)
sift = Sift(Index=Slider(1, range=0..30))
panel_8 = Panel("C:\Users\John Rao\Dropbox (MIT)\MIT_Work\4.451\Project\Presentation\Final\Sampling\Screenshots\Hyper\7")
panel_9 = Panel("C:\Users\John Rao\Dropbox (MIT)\MIT_Work\4.451\Project\Presentation\Final\Sampling")
capture = Capture(
    Variables=[additionalrotation, right, left, middle],
    Objectives=num,
    Mode=2,
    Properties=abs,
    DesignMap=panel_7,
    CsvFilename="SamplegHyper_25_40Rot4Capture",
    CsvDirectory=panel_9,
    ScreenshotFilename="sampleH7",
    ScreenshotDirectory=panel_8,
    BackupFrequency=0)  # -> DesignMapObjectives, CapturedProperties, Data, Images, Index
panel_10 = Panel(capture.CapturedProperties)
panel_11 = Panel(capture.DesignMapObjectives)
split = SplitList(List=panel_11, Index=4)  # -> ListA, ListB

# ==== cluster Cluster

# ==== cluster StructuralModelSetup
breps = ClusterInput()
debrep = DeconstructBrep(Breps=flatten(breps))  # -> Faces, Edges, Vertices
item = ListItem(List=debrep.Edges, Index=0, Wrap=True)  # -> Item, Item1, Item2, Item3, Item4, Item5, Item6, Item7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

# ---- group: LongHorizontals
crv = Curve(item.Item)
crv_2 = Curve(item.Item4)
crv_3 = Curve(item.Item6)
crv_4 = Curve(item.Item2)

# ---- group: CornerVerticals
crv_5 = Curve(item.Item8)
crv_6 = Curve(item.Item10)
crv_7 = Curve(item.Item11)
crv_8 = Curve(item.Item9)

# ---- group: ShortHorizontals
crv_9 = Curve(item.Item5)
crv_10 = Curve(item.Item7)
crv_11 = Curve(item.Item3)
crv_12 = Curve(item.Item1)

# ----
number_slider = Slider(17, range=0..20)
merge = Merge(Data1=crv_12, Data2=crv_11, Data3=crv_9, Data4=crv_10)
merge_2 = Merge(Data1=crv_5, Data2=crv_8, Data3=crv_6, Data4=crv_7)
divide = DivideCurve(Curve=crv_4, Count=number_slider, Kinks=False)  # -> Points, Tangents, Parameters
divide_2 = DivideCurve(Curve=crv_3, Count=number_slider, Kinks=False)  # -> Points, Tangents, Parameters
divide_3 = DivideCurve(Curve=crv_2, Count=number_slider, Kinks=False)  # -> Points, Tangents, Parameters
divide_4 = DivideCurve(Curve=crv, Count=number_slider, Kinks=False)  # -> Points, Tangents, Parameters
shatter = Shatter(Curve=crv_2, Parameters=divide_3.Parameters)
shatter_2 = Shatter(Curve=crv, Parameters=divide_4.Parameters)
shatter_3 = Shatter(Curve=crv_3, Parameters=divide_2.Parameters)
shatter_4 = Shatter(Curve=crv_4, Parameters=divide.Parameters)
subset = SubList(List=divide_2.Points, Domain="1 to 16", Wrap=True)  # -> List, Index
subset_2 = SubList(List=divide_4.Points, Domain="1 to 16", Wrap=True)  # -> List, Index
subset_3 = SubList(List=divide.Points, Domain="1 to 16", Wrap=True)  # -> List, Index
subset_4 = SubList(List=divide_3.Points, Domain="1 to 16", Wrap=True)  # -> List, Index
sort_pt = SortPoints(Points=subset_3.List)  # -> Points, Indices
sort_pt_2 = SortPoints(Points=subset_2.List)  # -> Points, Indices
sort_pt_3 = SortPoints(Points=subset_4.List)  # -> Points, Indices
sort_pt_4 = SortPoints(Points=subset.List)  # -> Points, Indices

# ---- group: supporPositions
item_2 = ListItem(List=divide_4.Points, Index=17, Wrap=True)
item_3 = ListItem(List=divide_4.Points, Index=0, Wrap=True)
item_4 = ListItem(List=divide_3.Points, Index=17, Wrap=True)
item_5 = ListItem(List=divide_3.Points, Index=0, Wrap=True)
item_6 = ListItem(List=divide.Points, Index=17, Wrap=True)
item_7 = ListItem(List=divide.Points, Index=0, Wrap=True)
item_8 = ListItem(List=divide_2.Points, Index=0, Wrap=True)
item_9 = ListItem(List=divide_2.Points, Index=17, Wrap=True)
merge_3 = Merge(Data1=item_5, Data2=item_4, Data3=item_3, Data4=item_2, Data5=item_8, Data6=item_9, Data7=item_7, Data8=item_6)
srf = Surface(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)
cp = PlaneClosestPoint(Point=merge_3, Plane=srf)  # -> Point, UVPoint, Distance
round = Round(Number=cp.Distance)  # -> Nearest, Floor, Ceiling
equals = Equality(FirstNumber=round.Nearest, SecondNumber="0")  # -> Equality, Inequality
dispatch = Dispatch(List=merge_3, DispatchPattern=equals.Equality)  # -> ListA, ListB
support_pos = Point(flatten(dispatch.ListA))

# ---- group: HorizontalReinforcements
ln = Line(StartPoint=sort_pt_2.Points, EndPoint=sort_pt.Points)
ln_2 = Line(StartPoint=sort_pt_3.Points, EndPoint=sort_pt_4.Points)
merge_4 = Merge(Data1=ln, Data2=ln_2)

# ---- group: VerticalReinforcements
ln_3 = Line(StartPoint=sort_pt_4.Points, EndPoint=sort_pt.Points)
ln_4 = Line(StartPoint=sort_pt_2.Points, EndPoint=sort_pt_3.Points)
merge_5 = Merge(Data1=ln_4, Data2=ln_3)

# ---- group: loadCalculation
loadpoint = Point([divide_2.Points, divide_3.Points])
multiplication = Multiplication(A="2300", B="2.2")
division = Division(A=multiplication, B="36")
division_2 = Division(A=division, B="1000")
Z = UnitZ(Factor=division_2)
neg = Negative(Value=Z)

# ----
panel = Panel("0.0393701")
multiplication_2 = Multiplication(A="153", B="0.0393701")
multiplication_3 = Multiplication(A="6", B="0.0393701")
multiplication_4 = Multiplication(A="36", B="0.0393701")
multiplication_5 = Multiplication(A="174", B="0.0393701")
multiplication_6 = Multiplication(A="3", B="0.0393701")
multiplication_7 = Multiplication(A="70", B="0.0393701")
multiplication_8 = Multiplication(A="206", B="0.0393701")
multiplication_9 = Multiplication(A="60", B="0.0393701")
multiplication_10 = Multiplication(A="2", B="0.0393701")
cross_section = CrossSectionKaramba3D(
    FamilyNameOfCrossSection="DefaultCroSec",
    Material=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,
    Height_in=multiplication_9,
    UpperFlangeWidth_in=multiplication_9,
    LowerFlangeWidth_in=multiplication_9,
    UpperFlangeThickness_in=multiplication_6,
    LowerFlangeThickness_in=multiplication_6,
    SidewallsThickness_in=multiplication_6,
    FilletRadius_in=0.2362204724,
    mode="Box")
cross_section_2 = CrossSectionKaramba3D(
    FamilyNameOfCrossSection="DefaultCroSec",
    Material=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,
    Height_in=multiplication_2,
    UpperFlangeWidth_in=multiplication_5,
    LowerFlangeWidth_in=multiplication_5,
    UpperFlangeThickness_in=multiplication_3,
    LowerFlangeThickness_in=multiplication_3,
    SidewallsThickness_in=multiplication_3,
    FilletRadius_in=0.2362204724,
    mode="Box")
cross_section_3 = CrossSectionKaramba3D(
    FamilyNameOfCrossSection="DefaultCroSec",
    Material=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,
    Height_in=multiplication_4,
    UpperFlangeWidth_in=multiplication_7,
    LowerFlangeWidth_in=multiplication_8,
    UpperFlangeThickness_in=multiplication_10,
    LowerFlangeThickness_in=multiplication_10,
    SidewallsThickness_in=multiplication_10,
    FilletRadius_in=0.2362204724,
    mode="Box")
crv_13 = Curve(shatter_2)
crv_14 = Curve(shatter)
crv_15 = Curve(shatter_4)
crv_16 = Curve(shatter_3)
merge_6 = Merge(Data1=crv_15, Data2=crv_16)
merge_7 = Merge(Data1=crv_13, Data2=crv_14)
llinter = LineLineIntersectionKaramba3D(Line=flatten([merge_6, merge_7, merge, merge_4]), LimitDistance_ft=0.005)  # -> IntersectionPoints, LineSubSegements
toggle = BooleanToggle(True)
rdlines = RemoveDuplicateLinesKaramba3D(Line=flatten(llinter.LineSubSegements), LimitDistance=0.005)  # -> OutLine, Info, Indexes
rdpoints = RemoveDuplicatePointsKaramba3D(Point=flatten(support_pos), LimitDistance=0.005)  # -> OutPoint, Info, Indexes
linetobeamfcp = LineToBeamKaramba3D(Line=merge_2, CrossSection=cross_section_2, New=True, Remove=True, LimitDistance_ft=0.005, Bending=toggle)  # -> Element, Points, Info
linetobeamtsr = LineToBeamKaramba3D(Line=rdlines.OutLine, CrossSection=cross_section, New=True, Remove=True, LimitDistance_ft=0.005, Bending=toggle)  # -> Element, Points, Info
linetobeamreinforv = LineToBeamKaramba3D(Line=merge_5, CrossSection=cross_section_3, New=True, Remove=True, LimitDistance_ft=0.005, Bending=Toggle(True))  # -> Element, Points, Info
supp = SupportKaramba3D(PosInd=rdpoints.OutPoint, menu=[buttons(on, on, on, on, on, on)])
loads = LoadsKaramba3D(ForceVector=neg, Local=False, PosInd=loadpoint, LCase=0, mode="Point")
merge_8 = Merge(Data1=linetobeamfcp.Element, Data3=linetobeamtsr.Element, Data5=linetobeamreinforv.Element)  # -> flatten(Elements)
elements = ClusterOutput(merge_8)
supports = ClusterOutput(supp)
load = ClusterOutput(loads)

# ==== cluster AggregationGeneration
field = ClusterInput()
part = ClusterInput()
baselist = ClusterInput()
prev = ClusterInput()
N = ClusterInput()
rules = ClusterInput()
reset = ClusterInput()
fieldaggregation = Wasp_FieldDrivenAggregation(PART=flatten(part), PREV=prev, N=N, RULES=rules, FIELD=field, MODE="3", RESET=reset)  # -> AGGR, PART_OUT; inputs PART: list, PREV: list, N: Int32, RULES: list, FIELD: list, MODE: Int32, GC: list, RESET: Boolean; plug-in component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
lng = ListLength(BaseList=baselist)
split = SplitList(List=fieldaggregation.PART_OUT, Index=lng)  # -> ListA, ListB
partgeo = Wasp_GetPartGeometry(PART=split.ListA)  # -> GEO; plug-in component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
partgeo_2 = Wasp_GetPartGeometry(PART=split.ListB)  # -> GEO; plug-in component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
geo = ClusterOutput(partgeo_2)
preview = CustomPreview(Geometry=partgeo, Material=ColourSwatch(SwatchColor=RGB(227, 214, 202)))

# ==== cluster BaseSetup
part = ClusterInput()

# ---- group: base
series = Series(Start=0, Step=Slider(8, range=0..10), Count=Slider(10, range=0..10))
X = UnitX(Factor=series)
move = Move(Motion=X)  # -> Geometry, Transform
parttr = Wasp_TransformPart(PART=part, TR=move.Transform)  # -> PART_OUT; plug-in component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
series_2 = Series(Start=0, Step=Slider(20, range=0..100), Count=Slider(4, range=0..10))
Y = UnitY(Factor=series_2)
move_2 = Move(Motion=Y)  # -> Geometry, Transform

# ----
parttr_2 = Wasp_TransformPart(PART=graft(parttr), TR=move_2.Transform)  # -> flatten(PART_OUT); plug-in component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

# ---- group: base (continued)
partgeo = Wasp_GetPartGeometry(PART=parttr_2)  # -> GEO; plug-in component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

# ----
part_out = ClusterOutput(parttr_2)
preview = CustomPreview(
    Geometry=partgeo,
    Material={diffuse=RGB(221, 160, 221), emission=RGB(66, 48, 66), shine=0.5, specular=RGB(255, 255, 255), transparency=0})

# ==== cluster AggregationPartSetup
additionalrotation = ClusterInput()
brep = ClusterInput()
Z = UnitZ(Factor=Slider(9.5, range=0..10))
neg = Negative(Value=Z)
Y = UnitY(Factor=Slider(20, range=0..100))
move = Move(Geometry=brep, Motion=neg)  # -> Geometry, Transform
neg_2 = Negative(Value=Y)
number_slider = Slider(3, range=0..20)
X = UnitX(Factor=Slider(16, range=0..20))
Z_2 = UnitZ(Factor=1)
move_2 = Move(Geometry=move.Geometry, Motion=neg_2)  # -> Geometry, Transform
neg_3 = Negative(Value=X)
move_3 = Move(Geometry=move_2.Geometry, Motion=neg_3)  # -> Geometry, Transform
Y_2 = UnitY(Factor=1)
debrep = DeconstructBrep(Brep=move_3.Geometry)  # -> Faces, Edges, Vertices
geo = Geometry(move_3.Geometry)
item = ListItem(List=debrep.Faces, Index=0, Wrap=True)  # -> Item, Item1, Item2, Item3, Item4, Item5
area = Area(Geometry=item.Item3)  # -> Area, Centroid
area_2 = Area(Geometry=item.Item4)  # -> Area, Centroid
Y_3 = UnitY(Factor=Slider(5, range=0..10))
Y_4 = UnitY(Factor=Slider(2.5, range=0..10))
Y_5 = UnitY(Factor=Slider(7.5, range=0..10))
Y_6 = UnitY(Factor=Slider(5, range=0..10))
Y_7 = UnitY(Factor=Slider(7.5, range=0..10))
Y_8 = UnitY(Factor=Slider(2.5, range=0..10))
number_slider_2 = Slider(90, range=0..100)
Y_9 = UnitY(Factor=Slider(5, range=0..10))
neg_4 = Negative(Value=Y_7)
Y_10 = UnitY(Factor=Slider(5, range=0..10))
Y_11 = UnitY(Factor=Slider(7.5, range=0..10))
Y_12 = UnitY(Factor=Slider(7.5, range=0..10))
neg_5 = Negative(Value=Y_5)
neg_6 = Negative(Value=Y_3)
neg_7 = Negative(Value=Y_6)
Y_13 = UnitY(Factor=Slider(2.5, range=0..10))
neg_8 = Negative(Value=Y_8)
Y_14 = UnitY(Factor=Slider(2.5, range=0..10))
neg_9 = Negative(Value=Y_4)
line = LineSDL(Start=area_2.Centroid, Direction=Z_2, Length=number_slider)
line_2 = LineSDL(Start=area.Centroid, Direction=Z_2, Length=number_slider)
neg_10 = Negative(Value=Y_9)
neg_11 = Negative(Value=Y_11)
neg_12 = Negative(Value=Y_12)
neg_13 = Negative(Value=Y_13)
neg_14 = Negative(Value=Y_14)
area_3 = Area(Geometry=item.Item2)  # -> Area, Centroid
neg_15 = Negative(Value=Y_10)
move_4 = Move(Geometry=area_3.Centroid, Motion=neg_4)  # -> Geometry, Transform
move_5 = Move(Geometry=area_3.Centroid, Motion=neg_7)  # -> Geometry, Transform
move_6 = Move(Geometry=area_3.Centroid, Motion=neg_8)  # -> Geometry, Transform
move_7 = Move(Geometry=area_3.Centroid, Motion=Y_8)  # -> Geometry, Transform
move_8 = Move(Geometry=area_3.Centroid, Motion=Y_6)  # -> Geometry, Transform
move_9 = Move(Geometry=area_3.Centroid, Motion=Y_7)  # -> Geometry, Transform
area_4 = Area(Geometry=item.Item5)  # -> Area, Centroid
move_10 = Move(Geometry=area_4.Centroid, Motion=neg_5)  # -> Geometry, Transform
move_11 = Move(Geometry=area_4.Centroid, Motion=neg_6)  # -> Geometry, Transform
move_12 = Move(Geometry=area_4.Centroid, Motion=neg_9)  # -> Geometry, Transform
move_13 = Move(Geometry=area_4.Centroid, Motion=Y_4)  # -> Geometry, Transform
move_14 = Move(Geometry=area_4.Centroid, Motion=Y_3)  # -> Geometry, Transform
move_15 = Move(Geometry=area_4.Centroid, Motion=Y_5)  # -> Geometry, Transform
area_5 = Area(Geometry=item.Item)  # -> Area, Centroid
move_16 = Move(Geometry=area_5.Centroid, Motion=neg_13)  # -> Geometry, Transform
move_17 = Move(Geometry=area_5.Centroid, Motion=Y_10)  # -> Geometry, Transform
move_18 = Move(Geometry=area_5.Centroid, Motion=Y_13)  # -> Geometry, Transform
area_6 = Area(Geometry=item.Item1)  # -> Area, Centroid
move_19 = Move(Geometry=area_6.Centroid, Motion=neg_14)  # -> Geometry, Transform
move_20 = Move(Geometry=area_5.Centroid, Motion=Y_11)  # -> Geometry, Transform
move_21 = Move(Geometry=area_6.Centroid, Motion=Y_14)  # -> Geometry, Transform
move_22 = Move(Geometry=area_6.Centroid, Motion=Y_9)  # -> Geometry, Transform
move_23 = Move(Geometry=area_6.Centroid, Motion=neg_10)  # -> Geometry, Transform
move_24 = Move(Geometry=area_5.Centroid, Motion=neg_15)  # -> Geometry, Transform
move_25 = Move(Geometry=area_6.Centroid, Motion=Y_12)  # -> Geometry, Transform
move_26 = Move(Geometry=area_5.Centroid, Motion=neg_11)  # -> Geometry, Transform
move_27 = Move(Geometry=area_6.Centroid, Motion=neg_12)  # -> Geometry, Transform
line_3 = LineSDL(Start=move_7.Geometry, Direction=Y_2, Length=number_slider)
line_4 = LineSDL(Start=move_9.Geometry, Direction=Y_2, Length=number_slider)
line_5 = LineSDL(Start=move_5.Geometry, Direction=Y_2, Length=number_slider)
crv = Curve([line_2, line])
line_6 = LineSDL(Start=move_6.Geometry, Direction=Y_2, Length=number_slider)
line_7 = LineSDL(Start=move_8.Geometry, Direction=Y_2, Length=number_slider)
line_8 = LineSDL(Start=move_15.Geometry, Direction=Y_2, Length=number_slider)
line_9 = LineSDL(Start=move_4.Geometry, Direction=Y_2, Length=number_slider)
line_10 = LineSDL(Start=area_4.Centroid, Direction=Y_2, Length=number_slider)
line_11 = LineSDL(Start=move_13.Geometry, Direction=Y_2, Length=number_slider)
line_12 = LineSDL(Start=move_14.Geometry, Direction=Y_2, Length=number_slider)
line_13 = LineSDL(Start=move_12.Geometry, Direction=Y_2, Length=number_slider)
line_14 = LineSDL(Start=move_10.Geometry, Direction=Y_2, Length=number_slider)
line_15 = LineSDL(Start=move_11.Geometry, Direction=Y_2, Length=number_slider)
pt = Point([area.Centroid, area_2.Centroid])
line_16 = LineSDL(Start=area_5.Centroid, Direction=Z_2, Length=number_slider)
line_17 = LineSDL(Start=move_17.Geometry, Direction=Z_2, Length=number_slider)
line_18 = LineSDL(Start=move_24.Geometry, Direction=Z_2, Length=number_slider)
line_19 = LineSDL(Start=move_20.Geometry, Direction=Z_2, Length=number_slider)
line_20 = LineSDL(Start=move_16.Geometry, Direction=Z_2, Length=number_slider)
line_21 = LineSDL(Start=move_18.Geometry, Direction=Z_2, Length=number_slider)
line_22 = LineSDL(Start=area_6.Centroid, Direction=Z_2, Length=number_slider)
line_23 = LineSDL(Start=area_3.Centroid, Direction=Y_2, Length=number_slider)
line_24 = LineSDL(Start=move_23.Geometry, Direction=Z_2, Length=number_slider)
line_25 = LineSDL(Start=move_21.Geometry, Direction=Z_2, Length=number_slider)
line_26 = LineSDL(Start=move_25.Geometry, Direction=Z_2, Length=number_slider)
line_27 = LineSDL(Start=move_22.Geometry, Direction=Z_2, Length=number_slider)
line_28 = LineSDL(Start=move_27.Geometry, Direction=Z_2, Length=number_slider)
line_29 = LineSDL(Start=move_26.Geometry, Direction=Z_2, Length=number_slider)
merge = Merge(Data1=line_29, Data2=line_18, Data3=line_20, Data4=line_16, Data5=line_21, Data6=line_17, Data7=line_19)
merge_2 = Merge(
    Data1=move_26.Geometry,
    Data2=move_24.Geometry,
    Data3=move_16.Geometry,
    Data4=area_5.Centroid,
    Data5=move_18.Geometry,
    Data6=move_17.Geometry,
    Data7=move_20.Geometry)
merge_3 = Merge(Data1=line_14, Data2=line_15, Data3=line_13, Data4=line_10, Data5=line_11, Data6=line_12, Data7=line_8)
line_30 = LineSDL(Start=move_19.Geometry, Direction=Z_2, Length=number_slider)
merge_4 = Merge(
    Data1=move_10.Geometry,
    Data2=move_11.Geometry,
    Data3=move_12.Geometry,
    Data4=area_4.Centroid,
    Data5=move_13.Geometry,
    Data6=move_14.Geometry,
    Data7=move_15.Geometry)
merge_5 = Merge(
    Data1=move_27.Geometry,
    Data2=move_23.Geometry,
    Data3=move_19.Geometry,
    Data4=area_6.Centroid,
    Data5=move_21.Geometry,
    Data6=move_22.Geometry,
    Data7=move_25.Geometry)
merge_6 = Merge(Data1=line_9, Data2=line_5, Data3=line_6, Data4=line_23, Data5=line_3, Data6=line_7, Data7=line_4)
merge_7 = Merge(Data1=line_28, Data2=line_24, Data3=line_30, Data4=line_22, Data5=line_25, Data6=line_27, Data7=line_26)
pt_2 = Point([move_11.Geometry, area_4.Centroid, move_14.Geometry])
crv_2 = Curve([line_15, line_10, line_12])
merge_8 = Merge(
    Data1=move_4.Geometry,
    Data2=move_5.Geometry,
    Data3=move_6.Geometry,
    Data4=area_3.Centroid,
    Data5=move_7.Geometry,
    Data6=move_8.Geometry,
    Data7=move_9.Geometry)
crv_3 = Curve([line_18, line_16, line_17])
pt_3 = Point([move_24.Geometry, area_5.Centroid, move_17.Geometry])
pt_4 = Point([move_23.Geometry, area_6.Centroid, move_22.Geometry])
crv_4 = Curve([line_24, line_22, line_27])
conndir = Wasp_ConnectionFromDirection(GEO=geo, CEN=pt, UP=crv, T="s_ends")  # -> CONN, PLN_OUT; inputs CEN: list of Point3d, UP: list of Curve, T: list; plug-in component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
crv_5 = Curve([line_5, line_23, line_7])
pt_5 = Point([move_5.Geometry, area_3.Centroid, move_8.Geometry])
conndir_2 = Wasp_ConnectionFromDirection(GEO=geo, CEN=pt_3, UP=crv_3, T="s_sideL")  # -> CONN, PLN_OUT; inputs CEN: list of Point3d, UP: list of Curve, T: list; plug-in component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
conndir_3 = Wasp_ConnectionFromDirection(GEO=geo, CEN=pt_4, UP=crv_4, T="s_sideR")  # -> CONN, PLN_OUT; inputs CEN: list of Point3d, UP: list of Curve, T: list; plug-in component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
conndir_4 = Wasp_ConnectionFromDirection(GEO=geo, CEN=pt_2, UP=crv_2, T="s_top")  # -> CONN, PLN_OUT; inputs CEN: list of Point3d, UP: list of Curve, T: list; plug-in component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
prot = RotatePlane(Plane=conndir_4.PLN_OUT, Angle=degrees(additionalrotation))
prot_2 = RotatePlane(Plane=conndir_4.PLN_OUT, Angle=degrees(number_slider_2))
connpln = Wasp_ConnectionFromPlane(PLN=prot, T="s_top_ROT")  # -> CONN, PLN_OUT; inputs PLN: list of Plane, T: list; plug-in component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
connpln_2 = Wasp_ConnectionFromPlane(PLN=prot_2, T="s_top_90")  # -> CONN, PLN_OUT; inputs PLN: list of Plane, T: list; plug-in component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
conndir_5 = Wasp_ConnectionFromDirection(GEO=geo, CEN=pt_5, UP=crv_5, T="s_bott")  # -> CONN, PLN_OUT; inputs CEN: list of Point3d, UP: list of Curve, T: list; plug-in component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
prot_3 = RotatePlane(Plane=conndir_5.PLN_OUT, AdditionalRotation=degrees(additionalrotation))
prot_4 = RotatePlane(Plane=conndir_5.PLN_OUT, Angle=degrees(number_slider_2))
connpln_3 = Wasp_ConnectionFromPlane(PLN=prot_3, T="s_bott_ROT")  # -> CONN, PLN_OUT; inputs PLN: list of Plane, T: list; plug-in component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
connpln_4 = Wasp_ConnectionFromPlane(PLN=prot_4, T="s_bott_90")  # -> CONN, PLN_OUT; inputs PLN: list of Plane, T: list; plug-in component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
merge_9 = Merge(
    Data1=conndir_2.CONN,
    Data2=conndir_3.CONN,
    Data3=conndir_5.CONN,
    Data4=connpln_4.CONN,
    Data5=conndir.CONN,
    Data6=conndir_4.CONN,
    Data7=connpln_2.CONN,
    Data8=connpln_3.CONN,
    Data9=connpln.CONN)
number_slider_3 = Slider(5, range=0..10)
Z_3 = UnitZ(Factor=1)
Z_4 = UnitZ(Factor=1)
Z_5 = UnitZ(Factor=1)
neg_16 = Negative(Value=Z_3)
neg_17 = Negative(Value=Z_4)
neg_18 = Negative(Value=Z_5)
line_31 = LineSDL(Start=move_6.Geometry, Direction=[neg_16, Z_3], Length=number_slider_3)
line_32 = LineSDL(Start=move_7.Geometry, Direction=[neg_16, Z_3], Length=number_slider_3)
line_33 = LineSDL(Start=move_4.Geometry, Direction=[neg_16, Z_3], Length=number_slider_3)
line_34 = LineSDL(Start=move_9.Geometry, Direction=[neg_16, Z_3], Length=number_slider_3)
line_35 = LineSDL(Start=move_5.Geometry, Direction=[neg_16, Z_3], Length=number_slider_3)
line_36 = LineSDL(Start=area_3.Centroid, Direction=[neg_17, Z_4], Length=Slider(5, range=0..10))
line_37 = LineSDL(Start=move_8.Geometry, Direction=[neg_18, Z_5], Length=Slider(5, range=0..10))
join = JoinCurves(Curves=line_31, Preserve=False)
join_2 = JoinCurves(Curves=line_32, Preserve=False)
join_3 = JoinCurves(Curves=line_34, Preserve=False)
join_4 = JoinCurves(Curves=line_33, Preserve=False)
join_5 = JoinCurves(Curves=line_36, Preserve=False)
join_6 = JoinCurves(Curves=line_35, Preserve=False)
join_7 = JoinCurves(Curves=line_37, Preserve=False)
support = Wasp_Support(DIR=[join_6, join_5], GEO=geo)  # -> SUP; inputs DIR: list of Curve, GEO: Mesh; plug-in component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
support_2 = Wasp_Support(DIR=[join_7, join_5], GEO=geo)  # -> SUP; inputs DIR: list of Curve, GEO: Mesh; plug-in component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
support_3 = Wasp_Support(DIR=[join_6, join_7], GEO=geo)  # -> SUP; inputs DIR: list of Curve, GEO: Mesh; plug-in component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
merge_10 = Merge(Data1=support, Data2=support_3, Data3=support_2)
advpart = Wasp_AdvancedPart(NAME="s", GEO=geo, CONN=flatten(merge_9), SUP=merge_10)  # -> PART; inputs GEO: Mesh, CONN: list, COLL: Mesh, HI: list, ATTR: list, SUP: list; plug-in component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
part = ClusterOutput(advpart)

# ==== cluster Cluster_2
C = ClusterInput()
cp = ControlPoints(Curve=C)  # -> Points, Weights, Knots
F = ClusterInput()
F_2 = ClusterInput()
F_3 = ClusterInput()
item = ListItem(List=cp.Points, Index=0, Wrap=True)  # -> Item, Item1, Item2, Item3, Item4
Z = UnitZ(Factor=F_3)
pt = Point(item.Item3)
pt_2 = Point(item.Item4)
Z_2 = UnitZ(Factor=F_2)
pt_3 = Point(item.Item2)
Z_3 = UnitZ(Factor=F)
pt_4 = Point(item.Item)
pt_5 = Point(item.Item1)
pdeform = PointDeform(Geometry=C, Points=[pt_5, pt_3, pt], Motion=[Z_3, Z_2, Z])

# ---- group: curveDriven
bbox = BoundingBox(Content=pdeform, Plane=PlaneXY(0, 0, 0))  # -> Box, Box_2
volume = Volume(Geometry=bbox.Box)  # -> Volume, Centroid
scale_nu = ScaleNU(
    Geometry=bbox.Box,
    Plane=volume.Centroid,
    ScaleX=Slider(1.5, range=0..10),
    ScaleY=Slider(1.5, range=0..10),
    ScaleZ=Slider(2, range=0..10))  # -> Geometry, Transform
fieldpts = Wasp_FieldPoints(BOU=scale_nu.Geometry, RES=Slider(4, range=0..10))  # -> E_FIELD, PTS; inputs BOU: list of Mesh; plug-in component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
pull = PullPoint(Point=fieldpts.PTS, Geometry=pdeform, ClosestOnly=True)  # -> ClosestPoint, Distance
bnd = Bounds(Numbers=pull.Distance)
remap = RemapNumbers(Value=pull.Distance, Source=bnd, Target="1 To 0")  # -> Mapped, Clipped
graph = GraphMapper(
    remap.Mapped,
    x0=0,
    x1=1,
    y0=0,
    y1=1,
    container_name="Bezier",
    cpx=[0, 0.6667551398, 0.7424740791, 1],
    cpy=[0, 0.2638700008, 0.4461758137, 1])
field = Wasp_Field(NAME="myField", E_FIELD=fieldpts.E_FIELD, VAL=graph)  # -> FIELD; inputs VAL: list; plug-in component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

# ----
gradient = Gradient(LowerLimit=0, UpperLimit=1, Parameter=graph, stops=[0: RGB(0, 128, 0), 0.5: RGB(255, 255, 0), 1: RGB(255, 0, 0)])
preview = CustomPreview(Geometry=fieldpts.PTS, Material=gradient)

field_2 = ClusterOutput(field)
